# Dynamo graph Basic_Operators.dyn (Dynamo 2.6.1.8786)

# group: Inputs
number_x = DoubleInput(20)
number_y = DoubleInput(10)

# group: Operators
add = number_x + number_y
sub = number_x - number_y
div = number_x / number_y
mul = number_x * number_y

# group: Outputs
watch = Watch(add)
watch_2 = Watch(sub)
watch_3 = Watch(div)
watch_4 = Watch(mul)
