# Dynamo graph Basic_Range.dyn (Dynamo 2.6.1.8786)

# group: Input
number = DoubleInput(2)
number_2 = DoubleInput(12)
number_3 = DoubleInput(2)

# group: Start = Start value of the list [index 0] End = last definite value of the list Step = get value for every instance of 'the input(number)' of the list
range = Range(start=number, end=number_2, step=number_3)

# group: Output of the previous nodes
watch = Watch(range)

# group: The average number between the (Start, End)
average = Math.Average(numbers=watch)

# group: Output of the previous node
watch_2 = Watch(average)
