# Dynamo graph Basic_Equal_or_Not.dyn (Dynamo 2.6.1.8786)

# group: Check Number Value (x) if not equal to Number Value (y)
number = DoubleInput(7)
number_2 = DoubleInput(15)
ne = number != number_2
watch = Watch(ne)

# group: Check String Value (x) if not equal to String Value (y)
string = StringInput("Sample String")
string_2 = StringInput("Sample 2 String")
ne_2 = string != string_2
watch_2 = Watch(ne_2)

# group: Check Number Value (x) if not equal to Number Value (y)
number_3 = DoubleInput(7)
number_4 = DoubleInput(15)
ne_3 = number_3 != number_4
watch_3 = Watch(ne_3)

# group: True/False Statement
string_3 = StringInput("X is not equal to Y")
string_4 = StringInput("X is equal to Y")

# group: if true, the get the String 'True' statement. if false, then get String 'False' statement
if_ = If(test=watch_3, true=string_3, false=string_4)

# group: Output
watch_4 = Watch(if_)
