# Dynamo graph Basic String Join.dyn (Dynamo 2.6.1.8786)

string = StringInput("string0")
string_2 = StringInput("string1")

# group: Merge Strings
concat = String.Concat(string0=string, string1=string_2)

watch = Watch(concat)
string_3 = StringInput("<spacer>")
string_4 = StringInput("string0")
string_5 = StringInput("string1")
string_6 = StringInput("string2")

# group: Join Strings with Separator
join = String.Join(separator=string_3, string0=string_4, string1=string_5, string2=string_6)

watch_2 = Watch(join)
