# Dynamo graph Basic Keyword Search.dyn (Dynamo 2.6.1.8786)

# group: Inputs
string = StringInput("asd_window_asd")
string_2 = StringInput("asd_door_asd")
string_3 = StringInput("gfd_door_gfd")
string_4 = StringInput("gfd_window_gfd")
string_5 = StringInput("jkl_window_jkl")

# group: List of all String Inputs
list_create = List.Create(item0=string, item1=string_2, item2=string_3, item3=string_4, item4=string_5)

watch = Watch(list_create)

# group: keyword search
string_6 = StringInput("window")

# group: Search keyword from the list of string
contains = String.Contains(str=watch, searchFor=string_6)

watch_2 = Watch(contains)

# group: Check if True
boolean = BoolSelector(true)

# group: Get all indeces of strings that contains the keyword
allIndicesOf = List.AllIndicesOf(list=watch_2, item=boolean)

# group: Output
watch_3 = Watch(allIndicesOf)

# group: Other String Queries
endsWith = String.EndsWith()  # unwired: str, searchFor
startsWith = String.StartsWith()  # unwired: str, searchFor
