# Dynamo graph Clash_Isolate_v.0.1.dyn "custom2_test" (Dynamo 2.6.1.8786)
# packages: Data-Shapes 2022.2.103, spring nodes 210.1.1, bimorphNodes 4.2.1, Clockwork for Dynamo 2.x 2.4.0

# group: A. UI
code_block = CodeBlock { "Clash Isolate"; }
code_block_2 = CodeBlock { "Start"; }
code_block_3 = CodeBlock { "Select  Category"; }
categories_list = Custom[Categories list]()  # package Data-Shapes; Gives list of all Revit categories and a matching list of their names
dropdown_data = Custom[DropDown Data](InputName=code_block_3, Keys=categories_list.Category_name_s, Values=categories_list.Category_name_s)  # package Data-Shapes; Create data for DropDown input in UI.MultiInputForm ++ . Check out www.data-shapes.net for more infos.
code_block_4 = CodeBlock { "Check Against"; }
categories_list_2 = Custom[Categories list]()
dropdown_data_2 = Custom[DropDown Data](InputName=code_block_4, Keys=categories_list_2.Category_name_s, Values=categories_list_2.Category_name_s)
list_create = List.Create(item0=dropdown_data, item1=dropdown_data_2)
boolean = BoolSelector(true)
code_block_5 = CodeBlock { "Cancel"; }
multipleinputform = Custom[MultipleInputForm ++](Description_optional=code_block, ButtonText_optional=code_block_2, Inputs=list_create, Toggle=boolean, CancelButtonText_optional=code_block_5)  # package Data-Shapes; Create a form with multiple inputs. see www.data-shapes.net for tutorials and infos!

# group: B. GET ELEMENTS BY CATEGORY
code_block_6 = CodeBlock(l=multipleinputform.User_Inputs)
# ---------- code_block_6.designscript (4 lines) ----------
// List 0
l[0];
// List 1
l[1];
# ----------------------------------------
all_elements_in_active_view = ElementsInView()
ꟿ_list_filterbycategoryname = Custom[ꟿ List.FilterByCategoryName](element=all_elements_in_active_view, categoryName=code_block_6.out0)  # package spring nodes; Filters the input elements by their category name. You can input multiple category names.
ꟿ_list_filterbycategoryname_2 = Custom[ꟿ List.FilterByCategoryName](element=all_elements_in_active_view, categoryName=code_block_6.out1)

# group: A. DUPLICATE CURRENT 3D VIEW
activeViewFromCurrentDocument = Custom[Document.ActiveViewFromCurrentDocument]()  # package Clockwork for Dynamo 2.x; Gets the active view of the current document
string = StringInput("Clash_Isolate_")
code_block_7 = CodeBlock { "_vs_"; }
watch = Watch(code_block_6.out0)
watch_2 = Watch(code_block_6.out1)
join = String.Join(separator=code_block_7, string0=watch, string1=watch_2)
add = string + join
duplicate = Custom[View.Duplicate](view=activeViewFromCurrentDocument, name=add)  # package Clockwork for Dynamo 2.x; Duplicates a given view

# group: C. CHECK CATEGORIES IF INTERSECTED
intersectsElement = Revit.Element.IntersectsElement(elementSetA=ꟿ_list_filterbycategoryname.in, elementSetB=ꟿ_list_filterbycategoryname_2.in)
intersectingElements = Results.ElementIntersectionResult.IntersectingElements(elementIntersectionResult=intersectsElement)
isEmpty = List.IsEmpty(list=intersectingElements@L2)
filterByBoolMask = List.FilterByBoolMask(list=intersectingElements, mask=isEmpty)
filterByBoolMask_2 = List.FilterByBoolMask(list=ꟿ_list_filterbycategoryname.in, mask=isEmpty)

# group: B. GET CLASHING ELEMENTS
list_create_2 = List.Create(item0=filterByBoolMask.out, item1=filterByBoolMask_2.out)
flatten = List.Flatten(list=list_create_2)

# group: C. ISOLATE CLASHING ELEMENT
temporarilyIsolateElement = Custom[View.TemporarilyIsolateElement](view=duplicate, element=flatten)  # package Clockwork for Dynamo 2.x; Temporarily isolates elements in the given view

# group: GET ALL ISOLATED ELEMENTS
all_elements_in_view_s = Custom[All Elements In View(s)](Views=temporarilyIsolateElement.view)  # package Data-Shapes; Retrieves all visible element in a view or a set of views

# group: D. GROUP CLASHING ELEMENTS BY CATEGORY
ꟿ_list_filterbycategoryname_3 = Custom[ꟿ List.FilterByCategoryName](element=all_elements_in_view_s, categoryName=watch)
ꟿ_list_filterbycategoryname_4 = Custom[ꟿ List.FilterByCategoryName](element=all_elements_in_view_s, categoryName=watch_2)

watch_3 = Watch(ꟿ_list_filterbycategoryname_3.in)
watch_4 = Watch(ꟿ_list_filterbycategoryname_4.in)
