# Dynamo graph Data_Export_toExcel_v0.1.dyn (Dynamo 2.6.1.8786)

categories = Categories("OST_Rooms")

# group: Get RVT Category
all_elements_of_category = ElementsOfCategory(Category=categories)
string = StringInput("Number")
getParameterValueByName = Element.GetParameterValueByName(element=all_elements_of_category, parameterName=string)
code_block = CodeBlock { " "; }
ne = getParameterValueByName != code_block
filterByBoolMask = List.FilterByBoolMask(list=all_elements_of_category, mask=ne)

string_2 = StringInput("Name")

# group: Get Parameter Values from the set category
id = Element.Id(element=filterByBoolMask.in)
string_3 = StringInput("Sub-element")
getParameterValueByName_2 = Element.GetParameterValueByName(element=filterByBoolMask.in, parameterName=string_3)
string_4 = StringInput("Level")
getParameterValueByName_3 = Element.GetParameterValueByName(element=filterByBoolMask.in, parameterName=string_4)
string_5 = StringInput("Room Category/Function")
getParameterValueByName_4 = Element.GetParameterValueByName(element=filterByBoolMask.in, parameterName=string_5)
string_6 = StringInput("Number")
getParameterValueByName_5 = Element.GetParameterValueByName(element=filterByBoolMask.in, parameterName=string_6)
getParameterValueByName_6 = Element.GetParameterValueByName(element=filterByBoolMask.in, parameterName=string_2)
string_7 = StringInput("Room Type")
getParameterValueByName_7 = Element.GetParameterValueByName(element=filterByBoolMask.in, parameterName=string_7)
string_8 = StringInput("Elevation Level")
getParameterValueByName_8 = Element.GetParameterValueByName(element=filterByBoolMask.in, parameterName=string_8)
string_9 = StringInput("Level")
getParameterValueByName_9 = Element.GetParameterValueByName(element=filterByBoolMask.in, parameterName=string_9)
string_10 = StringInput("Building Use")
getParameterValueByName_10 = Element.GetParameterValueByName(element=filterByBoolMask.in, parameterName=string_10)
string_11 = StringInput("Grid Line")
getParameterValueByName_11 = Element.GetParameterValueByName(element=filterByBoolMask.in, parameterName=string_11)

# group: Room Code (String.Join)
code_block_2 = CodeBlock(x1=getParameterValueByName_2, x2=getParameterValueByName_3, x3=getParameterValueByName_4, x4=getParameterValueByName_5) { x1 + "." + x2 + "." + x3 + "." + x4; }

# group: List Schedule Parameters
list_create = List.Create(item0=id, item1=code_block_2, item2=getParameterValueByName_6, item3=getParameterValueByName_7, item4=getParameterValueByName_8, item5=getParameterValueByName_9, item6=getParameterValueByName_10, item7=getParameterValueByName_11)

# group: Export to Excel
file_path = Filename("C:\Users\Bino\Desktop\Test\2200_Room Information.xlsx")
code_block_3 = CodeBlock { "Room Information"; }
code_block_4 = CodeBlock { 0; }
transpose = List.Transpose(lists=list_create)
boolean = BoolSelector(true)
exportExcel = Data.ExportExcel(filePath=file_path, sheetName=code_block_3, startRow=code_block_4, startCol=code_block_4, data=transpose, overWrite=boolean)
