# Dynamo graph Data_Import_frExcel_v0.1.dyn (Dynamo 2.6.1.8786)
# packages: archi-lab.net 2023.213.1523

categories = Categories("OST_Rooms")

# group: Get RVT Category
all_elements_of_category = ElementsOfCategory(Category=categories)
string = StringInput("Number")
getParameterValueByName = Element.GetParameterValueByName(element=all_elements_of_category, parameterName=string)
code_block = CodeBlock { " "; }
ne = getParameterValueByName != code_block
filterByBoolMask = List.FilterByBoolMask(list=all_elements_of_category, mask=ne)

# group: Get Data from Excel
file_path = Filename("C:\Users\Bino\Desktop\Test\2200_Room Information.xlsx")
file_from_path = FileObject(path=file_path)
code_block_2 = CodeBlock { "Room Information"; }
boolean = BoolSelector(false)
importExcel = Data.ImportExcel(file=file_from_path, sheetName=code_block_2, readAsStrings=boolean)
transpose = List.Transpose(lists=importExcel)

code_block_3 = CodeBlock { " "; }
replaceNull = archilab.Lists.Lists.ReplaceNull(list=transpose, replacement=code_block_3)

# group: Set data from Excel Column
string_2 = StringInput("Name")
code_block_4 = CodeBlock { 2; }
getItemAtIndex = List.GetItemAtIndex(list=replaceNull, index=code_block_4)
setParameterByName = Element.SetParameterByName(element=filterByBoolMask.in, parameterName=string_2, value=getItemAtIndex)

# group: Set data from Excel Column
string_3 = StringInput("Room Type")
code_block_5 = CodeBlock { 3; }
getItemAtIndex_2 = List.GetItemAtIndex(list=replaceNull, index=code_block_5)
setParameterByName_2 = Element.SetParameterByName(element=filterByBoolMask.in, parameterName=string_3, value=getItemAtIndex_2)

# group: Set data from Excel Column
string_4 = StringInput("Elevation Level")
code_block_6 = CodeBlock { 4; }
getItemAtIndex_3 = List.GetItemAtIndex(list=replaceNull, index=code_block_6)
setParameterByName_3 = Element.SetParameterByName(element=filterByBoolMask.in, parameterName=string_4, value=getItemAtIndex_3)

# group: Set data from Excel Column
string_5 = StringInput("Building Use")
code_block_7 = CodeBlock { 6; }
getItemAtIndex_4 = List.GetItemAtIndex(list=replaceNull, index=code_block_7)
setParameterByName_4 = Element.SetParameterByName(element=filterByBoolMask.in, parameterName=string_5, value=getItemAtIndex_4)

# group: Set data from Excel Column
string_6 = StringInput("Grid Line")
code_block_8 = CodeBlock { 7; }
getItemAtIndex_5 = List.GetItemAtIndex(list=replaceNull, index=code_block_8)
setParameterByName_5 = Element.SetParameterByName(element=filterByBoolMask.in, parameterName=string_6, value=getItemAtIndex_5)
