# Dynamo graph Model_Warnings_v.01.dyn (Dynamo 2.6.1.8786)
# packages: Bang! 2021.4.3, Data-Shapes 2022.2.103, archi-lab.net 2023.213.1523

# group: [0] Switch
# note: Duplicate any views; preferably 3D.
# - Show all elements in view.
# - Toggle the Boolean Switch to re-evauluate the script (must be at your specified view.)
# Bino
switch = BoolSelector(true)  # graph input

# group: [3]get all elements with warning
getWarnings = Bang.Revit.Elements.WarningTools.GetWarnings(toggle=switch)
flatten = List.Flatten(list=getWarnings.Failing_Elements)

# group: [4] count elements with warning
code_block = CodeBlock { " - "; }
string = StringInput("WARNINGS!")
count = List.Count(list=flatten)
string_from_object = FromObject(obj=count)
join = String.Join(separator=code_block, string0=string, string1=string_from_object)
code_block_2 = CodeBlock { " - "; }
string_2 = StringInput("WARNINGS!")
code_block_3 = CodeBlock { "0 / null"; }
join_2 = String.Join(separator=code_block_2, string0=string_2, string1=code_block_3)
if_ = If(test=flatten, true=join, false=join_2)

# group: [5] set viewname
number = DoubleInput(0)
getItemAtIndex = List.GetItemAtIndex(list=if_, index=number)

# group: [1]rename current view based on warning count
current = Document.Current()
activeView = Document.ActiveView(document=current)
setName = archilab.Revit.Views.Views.SetName(view=activeView, name=getItemAtIndex)

# group: [2] get all elements in view and hide all
all_elements_in_view_s = Custom[All Elements In View(s)](Views=setName)  # package Data-Shapes; Retrieves all visible element in a view or a set of views
flatten_2 = List.Flatten(list=all_elements_in_view_s)
hideElements = archilab.Revit.Views.Views.HideElements(view=setName, elements=flatten_2)

# group: [6]unhide elements with warning in view
unHideElements = archilab.Revit.Views.Views.UnHideElements(view=setName, elements=flatten)

# group: sequence: [0] switch [1] Hide all elements in current.view [2] Show only elements with warning
code_block_4 = CodeBlock(x=switch, a=hideElements, b=unHideElements)
# ---------- code_block_4.designscript (3 lines) ----------
x?
a:
b;
# ----------------------------------------
