# Dynamo graph GeometryCurve_toWallType_v.01.dyn (Dynamo 2.6.1.8786)

select_model_elements = DSModelElementsSelection()  # 4 picked in the model
wall_types = WallTypes("Wall Test Def")
levels = Levels("Level 0")
levels_2 = Levels("Level 1")
elevation = Level.Elevation(level=levels_2)
python_script = Python(IN[0]=select_model_elements, IN[1]=wall_types, IN[2]=levels, IN[3]=elevation)
# ---------- python_script.python (94 lines) ----------
# --------------------------------------------
# Load the Python Standard Libraries
import sys
# --------------------------------------------
# Import Design Script
# Converts other languages into Python Syntax
# clr = Common Language Runtime
import clr
clr.AddReference('ProtoGeometry')
from Autodesk.DesignScript.Geometry import *
# --------------------------------------------
# This library containts Dynamo to Revit Elements
clr.AddReference("RevitNodes")
import Revit
clr.ImportExtensions(Revit.Elements)
# --------------------------------------------
# This library translates Dynamo Objects into Revit Object
clr.ImportExtensions(Revit.GeometryConversion)
# --------------------------------------------
# Import RevitServices Transactions
# This library tells Dynamo to "stop-running" once the operation is completed
# e.g. "History"
clr.AddReference("RevitServices")
import RevitServices
from RevitServices.Persistence import DocumentManager
from RevitServices.Transactions import TransactionManager
# --------------------------------------------
# Import RevitAPI Library
clr.AddReference("RevitAPI")
import Autodesk
from Autodesk.Revit.DB import *
from Autodesk.Revit.DB.Architecture import *
# --------------------------------------------


# Constants
# Below suggest that to run the program only to the live (current) document 
doc = DocumentManager.Instance.CurrentDBDocument

# ----------------------------

# The inputs to this node will be stored as a list in the IN variables.
dataEnteringNode = IN

# # Variables
# ## = UnwrapElement(IN[0]) This translates dynamo Object into Revit object
# line = UnwrapElement(IN[0])
lines = UnwrapElement(IN[0]) 


wallType = UnwrapElement(IN[1])
wallTypeID = wallType.Id


level = UnwrapElement(IN[2])
levelId = level.Id

height = UnwrapElement(IN[3])
heightMM = height/304.8


offset = 0

flip = False



result = []

# Functions
def MakeWall(geoCurve):
	newWall = Wall.Create(doc, geoCurve, wallTypeID, levelId, heightMM, offset, flip, False)
	return newWall




# This is the runner
with Transaction(doc, "insert transaction name") as transaction:
	transaction.Start()
	# --------------------------------------------------
	for line in lines:
		geoCurve = line.GeometryCurve
		if geoCurve.Length > 20: 
			newWall = MakeWall(geoCurve)
			result.append(newWall.Id)
	# --------------------------------------------------
	transaction.Commit()


# Assign your output to the OUT variable.
# Call the Function
# OUT = newWall
OUT = result
# ----------------------------------------
watch = Watch(python_script)
